% Simulink data dictionary Navigation.sldd

IMU_meas = Simulink.Bus()  % IMU measurements
  acc_timestamp: double, Unit="sec"  % timestamp of acceleration measurement
  gyro_timestamp: double, Unit="sec"  % timestamp of gyroscope measurement
  acc: double[3 1], Unit="m/s^2"  % measured acceleration
  gyro: double[3 1], Unit="rad/s"  % measured angular rates

radio_meas = Simulink.Bus()
  range_PN: double, Unit="m"  % Range measurements using the pseudo-noise signal
  range_CP: double, Unit="m"  % Range measurements using the carrier phase measurement
  range_rate: double, Unit="m/s"  % Range rate measurements
  range_timestamp: double, Unit="s"  % Range timestamp
  range_rate_timestamp: double, Unit="s"  % Range rate timestamp

c = struct(unit="km/s", description="Speed of light in vacuum", value=299792.458)

starTracker_meas = Simulink.Bus()  % star tracker measurements bus
  P_qq: double[3 3]  % 3x3 Covariance matrix of the measured quaternion
  timestamp: double, Unit="sec"  % measure timestamp
  quaternion: double[4 1]  % measured quaternion

Measurements = Simulink.Bus()  % Bus containing all the measurements
  radio: Bus: radio_meas
  IMU: Bus: IMU_meas
  starTracker: Bus: starTracker_meas

StartDate = struct(year=2027, month=1, day=1, hour=0, min=0, sec=0)

Propagation = struct(
  lf=struct(value=5, unit="Hz", description="State propagation frequency"),
  hf=struct(value=30, unit="Hz", description="Higher propagation frequency for IMU error comoensation algorithms"),
  Earth=struct(
    mu=struct(value=398600, unit="km^3/s^2"),
    amp=struct(
      value=[-383000 -31500 -10600 -6200 -3200 -2300 -800
       -351000 -28900 -13700 -9700 -5700 -2900 -2100
       -153200 -31500 -12500 -4200 -2500 -3000 -1800],
      unit="km",
      description="Amplitude coefficients for the position of the simplified earth model"),
    freq=struct(
      value=[8399.685 70.99 16728.377 1185.622 7143.07 15613.745 8467.263
       8399.687 70.997 8433.466 16728.38 1185.667 7143.058 15613.755
       8399.672 8433.464 70.996 16728.364 1185.645 104.881 8399.116],
      unit="Hz",
      description="Frequency coefficients for the position of the simplified earth model"),
    phase=struct(
      value=[5.381 6.169 1.453 0.481 5.017 0.857 1.01
       3.811 4.596 4.766 6.165 5.164 0.3 5.565
       3.807 1.629 4.595 6.162 5.167 2.555 6.248],
      unit="rad",
      description="phase coefficients for the position of the simplified earth model"),
    radius=struct(unit="km", value=6378.1363)),
  Moon=struct(
    mu=struct(value=4900.2800238, unit="km^3/s^2"),
    radius=struct(value=1738, unit="km"),
    SH=struct(
      n=struct(value=10, description="degree index"),
      m=struct(value=10, description="order index"),
      Pnm=struct(value=[1 0 1.732051], description="P00, P01, P11"),
      csi=struct(
        value=[0 0 0 0 0 0 0 0 0 0 0
         0 0 0 0 0 0 0 0 0 0 0
         1.936492 2.236068 0 0 0 0 0 0 0 0 0
         1.972027 2.09165 2.645751 0 0 0 0 0 0 0 0
         1.984313 2.04939 2.291288 3 0 0 0 0 0 0 0
         1.989975 2.03101 2.171241 2.487469 3.316625 0 0 0 0 0 0
         1.993043 2.021315 2.113942 2.301368 2.673948 3.605551 0 0 0 0 0
         1.994891 2.015564 2.081666 2.20794 2.430862 2.850439 3.872983 0 0 0 0
         1.99609 2.01187 2.061553 2.153222 2.304886 2.557042 3.017804 4.123106 0 0 0
         1.996911 2.009353 2.048122 2.118044 2.229177 2.401636 2.679138 3.177066 4.358899 0 0
         1.997498 2.007561 2.038688 2.093947 2.179449 2.306513 2.496873 2.797057 3.329164 4.582576 0],
        description="coefficients to propagate the Legendre polynomials"),
      eta=struct(
        value=[0 0 0 0 0 0 0 0 0 0 0
         0 0 0 0 0 0 0 0 0 0 0
         1.118034 0 0 0 0 0 0 0 0 0 0
         1.01835 0.9354143 0 0 0 0 0 0 0 0 0
         1.006231 0.9797959 0.8660254 0 0 0 0 0 0 0 0
         1.002853 0.9910312 0.9476071 0.8291562 0 0 0 0 0 0 0
         1.001542 0.9952267 0.9736101 0.9251849 0.8062258 0 0 0 0 0 0
         1.000927 0.997155 0.9847319 0.9594032 0.9090909 0.7905694 0 0 0 0 0
         1.000601 0.9981668 0.9903379 0.9752174 0.9481764 0.8970695 0.7791937 0 0 0 0
         1.000411 0.9987492 0.9934853 0.9836628 0.9671528 0.9392246 0.8877771 0.7705518 0 0 0
         1.000294 0.9991083 0.9953938 0.9886231 0.9776924 0.9603921 0.931969 0.88039 0.7637626 0 0],
        description="coefficients to propagate the Legendre polynomials"),
      zeta=struct(
        value=[0 0 0 0 0 0 0 0 0 0 0
         0 0 0 0 0 0 0 0 0 0 0
         1.732051 2 0 0 0 0 0 0 0 0 0
         2.44949 3.162278 2.44949 0 0 0 0 0 0 0 0
         3.162278 4.242641 3.741657 2.828427 0 0 0 0 0 0 0
         3.872983 5.291503 4.898979 4.242641 3.162278 0 0 0 0 0 0
         4.582576 6.324555 6 5.477226 4.690416 3.464102 0 0 0 0 0
         5.291503 7.348469 7.071068 6.63325 6 5.09902 3.741657 0 0 0 0
         6 8.3666 8.124038 7.745967 7.211103 6.480741 5.477226 4 0 0 0
         6.708204 9.380832 9.165151 8.831761 8.3666 7.745967 6.928203 5.830952 4.242641 0 0
         7.416198 10.3923 10.19804 9.899495 9.486833 8.944272 8.246211 7.348469 6.164414 4.472136 0],
        description="coefficients to compute the gravitational acceleration"),
      Cnm=struct(
        value=[0 0 0 0 0 0 0 0 0 0 0
         0 0 0 0 0 0 0 0 0 0 0
         -9.089015e-05 -2.962036e-08 3.463209e-05 0 0 0 0 0 0 0 0
         -3.24496e-06 2.638547e-05 1.419184e-05 1.228156e-05 0 0 0 0 0 0 0
         3.286678e-06 -5.978221e-06 -7.150751e-06 -1.359494e-06 -6.001626e-06 0 0 0 0 0 0
         -2.530739e-07 -1.144613e-06 4.419088e-06 5.473673e-07 2.74319e-06 3.046958e-06 0 0 0 0 0
         3.691945e-06 1.642643e-06 -4.232775e-06 -3.372817e-06 1.689058e-07 1.433699e-06 -4.560226e-06 0 0 0 0
         5.694974e-06 7.586529e-06 -7.75576e-07 4.16114e-07 -8.55206e-07 9.966364e-08 -9.627454e-07 -1.989445e-06 0 0 0
         2.288258e-06 -6.89421022522e-8 3.001645e-06 -1.878161e-06 3.633517e-06 -1.053987e-06 -2.091723e-06 -1.734175e-06 -2.320601e-06 0 0
         -3.468665e-06 2.113954e-06 1.855938e-06 -2.063234e-06 -1.6956e-06 -1.81353e-06 -2.599316e-06 -3.467338e-06 -9.602593e-07 -1.032916e-06 0
         -8.431876e-07 6.177881e-07 7.837813e-08 6.521969e-07 -3.429879e-06 3.111767e-07 5.080282e-08 -3.232749e-06 -3.83168e-06 -5.183202e-06 9.152631e-07],
        description="S.h. sine coefficients"),
      Snm=struct(
        value=[0 0 0 0 0 0 0 0 0 0 0
         0 0 0 0 0 0 0 0 0 0 0
         0 -2.771463e-08 2.3783e-08 0 0 0 0 0 0 0 0
         0 5.511503e-06 4.945406e-06 -1.839432e-06 0 0 0 0 0 0 0
         0 1.73215e-06 -6.926699e-06 -1.353789e-05 4.019687e-06 0 0 0 0 0 0
         0 -4.213482e-06 9.333326e-07 8.930777e-06 1.745584e-07 -2.875373e-06 0 0 0 0 0
         0 -2.646497e-06 -2.046457e-06 -3.307713e-06 -4.346605e-06 -1.044093e-05 7.368941e-06 0 0 0 0
         0 -1.767727e-07 2.381876e-06 2.289896e-06 7.092975e-07 1.400394e-06 1.20922e-06 -1.750367e-06 0 0 0
         0 1.004944e-06 2.157063e-06 1.150316e-06 -5.25921e-07 2.88165e-06 -2.502129e-06 3.112287e-06 2.276247e-06 0 0
         0 2.52272e-07 -1.158783e-06 1.84099e-06 -1.793918e-06 -3.537263e-06 -2.910556e-06 3.564903e-07 -1.95079e-06 2.337577e-06 0
         0 -8.928975e-07 -4.652173e-07 4.070344e-07 1.931351e-06 1.867004e-07 -1.983544e-06 -1.009771e-06 2.340488e-06 -4.437666e-07 -1.602837e-06]),
      Znm=struct(
        value=[0 0 0 0 0 0 0 0 0 0 0
         0 0 0 0 0 0 0 0 0 0 0
         3.464102 0 0 0 0 0 0 0 0 0 0
         7.745967 7.745967 0 0 0 0 0 0 0 0 0
         13.41641 15.87451 10.58301 0 0 0 0 0 0 0 0
         20.4939 25.92296 20.78461 13.41641 0 0 0 0 0 0 0
         28.98275 37.94733 32.86335 25.69047 16.24808 0 0 0 0 0 0
         38.88444 51.96152 46.90416 39.7995 30.59412 19.07878 0 0 0 0 0
         50.1996 67.97058 62.92853 55.85696 46.73329 35.49648 21.9089 0 0 0 0
         62.92853 85.97674 80.94443 73.89181 64.80741 53.66563 40.39802 24.73863 0 0 0
         77.0714 105.9811 100.9554 93.91486 84.85281 73.75636 60.59703 45.29901 27.5681 0 0])),
    eul0=struct(
      value=[0.2547045 0.3880776 0.04558641],
      unit="rad",
      description="Initial ZXZ rotation angles from J2000 to MOON_PA"),
    eul_dot=struct(
      value=[2.664488e-06 1.934342e-10 -2.735361e-09],
      unit="rad/s",
      description="Time derivative of the ZXZ rotation angles from J2000 to MOON_PA")),
  Sun=struct(mu=struct(value=132712440018, unit="km^3/s^2"), radius=struct(value=696000, unit="km")))

R_sensor2body = struct(
  value=[0.1268265 -0.7803301 0.6123724; 0.9267767 -0.1268265 -0.3535534; 0.3535534 0.6123724 0.7071068],
  unit="",
  description="Rotation matrix from IMU to body frame")

P0 = struct(
  description="Initial covariance matrix",
  value=[0.01 0 0 0 0 0 0 0 0 0 0 0 0 0 0 0 0 0 0 0 0
   0 0.01 0 0 0 0 0 0 0 0 0 0 0 0 0 0 0 0 0 0 0
   0 0 0.01 0 0 0 0 0 0 0 0 0 0 0 0 0 0 0 0 0 0
   0 0 0 1.0e-8 0 0 0 0 0 0 0 0 0 0 0 0 0 0 0 0 0
   0 0 0 0 1.0e-8 0 0 0 0 0 0 0 0 0 0 0 0 0 0 0 0
   0 0 0 0 0 1.0e-8 0 0 0 0 0 0 0 0 0 0 0 0 0 0 0
   0 0 0 0 0 0 7.615435e-05 0 0 0 0 0 0 0 0 0 0 0 0 0 0
   0 0 0 0 0 0 0 7.615435e-05 0 0 0 0 0 0 0 0 0 0 0 0 0
   0 0 0 0 0 0 0 0 7.615435e-05 0 0 0 0 0 0 0 0 0 0 0 0
   0 0 0 0 0 0 0 0 0 0.01 0 0 0 0 0 0 0 0 0 0 0
   0 0 0 0 0 0 0 0 0 0 0.01 0 0 0 0 0 0 0 0 0 0
   0 0 0 0 0 0 0 0 0 0 0 0.01 0 0 0 0 0 0 0 0 0
   0 0 0 0 0 0 0 0 0 0 0 0 1.0e-8 0 0 0 0 0 0 0 0
   0 0 0 0 0 0 0 0 0 0 0 0 0 1.0e-8 0 0 0 0 0 0 0
   0 0 0 0 0 0 0 0 0 0 0 0 0 0 1.0e-8 0 0 0 0 0 0
   0 0 0 0 0 0 0 0 0 0 0 0 0 0 0 4.178565e-11 0 0 0 0 0
   0 0 0 0 0 0 0 0 0 0 0 0 0 0 0 0 4.178565e-11 0 0 0 0
   0 0 0 0 0 0 0 0 0 0 0 0 0 0 0 0 0 4.178565e-11 0 0 0
   0 0 0 0 0 0 0 0 0 0 0 0 0 0 0 0 0 0 898.7552 0 0
   0 0 0 0 0 0 0 0 0 0 0 0 0 0 0 0 0 0 0 0.00044039 0
   0 0 0 0 0 0 0 0 0 0 0 0 0 0 0 0 0 0 0 0 8.987552e-22])

x0 = struct(
  value=[2000; 0; 0; 0; 1.106829; 1.106829; -0.2705981; -0.6532815; 0.2705981; 0.6532815; -39287.5; -6.383566; 23560.21; 0.08814962; -0.3665789; -0.02217941; 0; 0; 0; 0; 0; 0; 0; 0; 0],
  description="Initial state. position main [km]; velocity main [km/s]; quaternions [-]; position beacon [km]; velocity beacon [km/s]; bias accelerometer [m/s^2]; bias gyro [rad/s]; bias clock [km]; drift clock [km/s]")

SRP = struct(
  AU=struct(unit="km", description="Astronomical Unit to km conversion", value=149597870.691),
  radiation_pressure=struct(description="Solar radiation pressure", unit="N/m^2", value=4.56e-06),
  MainSpacecraft=struct(
    C_R=struct(value=1.3, unit="", description="Radiation pressure coefficient"),
    mass=struct(value=25, unit="kg", description="Spacecraft mass"),
    radius=struct(
      value=0.1595769,
      unit="m",
      description="Equivalent radius of a sphere with the same surface area of a 12u (20x20x30 cm) cubesat")),
  BeaconSpacecraft=struct(
    C_R=struct(value=1.3, unit="", description="Radiation pressure coefficient"),
    mass=struct(value=25, unit="kg", description="Spacecraft mass"),
    radius=struct(
      value=0.1595769,
      unit="m",
      description="Equivalent radius of a sphere with the same surface area of a 12u (20x20x30 cm) cubesat")))

statesBus = Simulink.Bus()
  x_m: double[3 1], Unit="km"  % Main spacecraft position
  v_m: double[3 1], Unit="km/s"  % Main spacecraft velocity
  q_m: double[4 1]  % Main spacecraft attitude quaternion
  x_b: double[3 1], Unit="km"  % beacon spacecraft position
  v_b: double[3 1], Unit="km/s"  % beacon spacecraft position
  bias_gyro: double[3 1], Unit="rad/s"  % gyroscope bias
  bias_clock: double, Unit="km"  % clock bias
  drift_clock: double, Unit="km/s"  % clock drift
  aging_clock: double, Unit="km/s^2"  % clock aging

IMU_filter = struct(
  Q_bias=struct(
    description="Process noise of the bias estimation filter, defined as diag([dt*ones(3,1)*IMU.accelerometer.N.value^2-dt*ones(3,1)*IMU.accelerometer.K.value^2; ones(3,1)*1e-8*dt])",
    value=[4.536458e-08 0 0 0 0 0
     0 4.536458e-08 0 0 0 0
     0 0 4.536458e-08 0 0 0
     0 0 0 3.333333e-10 0 0
     0 0 0 0 3.333333e-10 0
     0 0 0 0 0 3.333333e-10]),
  R_bias=struct(
    value=[1.0e-6 0 0; 0 1.0e-6 0; 0 0 1.0e-6],
    description="Measurement noise for the bias estimation filter"),
  Q_acc=struct(
    value=[4.537037e-08 0 0; 0 4.537037e-08 0; 0 0 4.537037e-08],
    description="Process noise of the accelerometer filter, defined as diag([IMU.accelerometer.sampleTime.value*ones(3,1)*IMU.accelerometer.N.value^2])"),
  K_acc=struct(
    value=[0.05609241 0 0; 0 0.05609241 0; 0 0 0.05609241],
    description="Steady state kalman gain of the acceleration filter"),
  Pcomp_acc=struct(
    description="Covariance to be added to the Bias covariance when the filter switches its reference acceleration; defined as IMU.accelerometer.N.value^2/IMU.accelerometer.sampleTime.value*eye(3)",
    value=[4.083333e-05 0 0; 0 4.083333e-05 0; 0 0 4.083333e-05]))

R_st = struct(description="Star tracker measurement noise", value=[9.0e-9 0 0; 0 5.0e-10 0; 0 0 5.0e-10])

R_radio = struct(
  description="Measurement noise matrix of the range and range rate measurements",
  value=[7.35e-05 0; 0 2.4e-07])

Q = struct(
  description="Process noise matrix",
  value=[2.135523e-12 0 0 0 0 0 0 0 0 0 0 0 0 0 0
   0 1.810993e-12 0 0 0 0 0 0 0 0 0 0 0 0 0
   0 0 1.472304e-12 0 0 0 0 0 0 0 0 0 0 0 0
   0 0 0 2.099547e-19 0 0 0 0 0 0 0 0 0 0 0
   0 0 0 0 1.976302e-19 0 0 0 0 0 0 0 0 0 0
   0 0 0 0 0 1.051425e-19 0 0 0 0 0 0 0 0 0
   0 0 0 0 0 0 1.9039e-9 0 0 0 0 0 0 0 0
   0 0 0 0 0 0 0 1.9039e-9 0 0 0 0 0 0 0
   0 0 0 0 0 0 0 0 1.9039e-9 0 0 0 0 0 0
   0 0 0 0 0 0 0 0 0 8.8399e-15 0 0 0 0 0
   0 0 0 0 0 0 0 0 0 0 8.8399e-15 0 0 0 0
   0 0 0 0 0 0 0 0 0 0 0 8.8399e-15 0 0 0
   0 0 0 0 0 0 0 0 0 0 0 0 2.696266e-22 0 0
   0 0 0 0 0 0 0 0 0 0 0 0 0 1.0e-22 0
   0 0 0 0 0 0 0 0 0 0 0 0 0 0 0])