% Simulink data dictionary Scenario.sldd

time = struct(value=1296000, unit="sec", description="Integration time")

celestialBodies = Simulink.Bus()
  Sun: double[3 1], Unit="km"  % Sun's position wrt to the moon
  Mercury: double[3 1], Unit="km"  % Mercury's postion wrt the moon
  Venus: double[3 1], Unit="km"  % Venus' position wrt to the moon
  Earth: double[3 1], Unit="km"  % Earth's position wrt to the moon
  Mars: double[3 1], Unit="km"  % Mars' position wrt to the moon
  Jupiter: double[3 1], Unit="km"  % Jupiter's position wrt to the moon
  Saturn: double[3 1], Unit="km"  % Saturn's position wrt to the moon
  Uranus: double[3 1], Unit="km"  % Uranus' position wrt to the moon
  Neptune: double[3 1], Unit="km"  % Neptune's position wrt to the moon
  Pluto: double[3 1], Unit="km"  % Pluto's position wrt to the moon
  Moon: double[3 1], Unit="km"  % Moon position wrt the moon
  J2000ToMPA: double[6 6]  % 6x6 rotation from J2000 to MPA refernce frame

accelerations = Simulink.Bus()
  Sun: double[3 1], Unit="km/s^2"  % Acceleration caused by the sun's gravity
  Mercury: double[3 1], Unit="km/s^2"  % Acceleration caused by mercury's gravity
  Venus: double[3 1], Unit="km/s^2"  % Acceleration caused by venus's gravity
  Earth: double[3 1], Unit="km/s^2"  % Acceleration caused by earth's gravity
  Mars: double[3 1], Unit="km/s^2"  % Acceleration caused by mars's gravity
  Jupiter: double[3 1], Unit="km/s^2"  % Acceleration caused by jupiter's gravity
  Saturn: double[3 1], Unit="km/s^2"  % Acceleration caused by saturn's gravity
  Uranus: double[3 1], Unit="km/s^2"  % Acceleration caused by uranus's gravity
  Neptune: double[3 1], Unit="km/s^2"  % Acceleration caused by Neptune's gravity
  Pluto: double[3 1], Unit="km/s^2"  % Acceleration caused by pluto's gravity
  Moon_point_mass: double[3 1], Unit="km/s^2"  % Acceleration caused by moon's point mass gravity
  Moon_sh: double[3 1], Unit="km/s^2"  % Acceleration caused by the moon's spherical harmonics  gravity
  srp: double[3 1], Unit="km/s^2"  % Acceleration caused by the solar radiation pressure
  thrust: double[3 1], Unit="km/s^2"  % acceleration due to thrusters

spacecraftState = Simulink.Bus()  % Spacecraft's simulation data
  x: double[3 1], Unit="km"  % Spacecraft position
  v: double[3 1], Unit="km/s"  % Spacecraft velocity
  w: double[3 1], Unit="rad/s"  % Spacecraft angular rates
  q: double[4 1]  % Spacecraft orientation wrt J2000 (quaternions scalar last)
  a: Bus: accelerations

simulationDataBus = Simulink.Bus()
  celestialBodies: Bus: celestialBodies
  beaconSpacecraft: Bus: spacecraftState
  mainSpacecraft: Bus: spacecraftState

Environment = struct(
  Sun=struct(
    mu=struct(value=132712440018, unit="km^3/s^2"),
    radius=struct(value=696000, unit="km"),
    P=struct(description="Solar radiation pressure", unit="Nkm-2", value=4.56)),
  Mercury=struct(mu=struct(value=22032, unit="km^3/s^2")),
  Venus=struct(mu=struct(value=324859, unit="km^3/s^2")),
  Earth=struct(mu=struct(value=398600, unit="km^3/s^2"), radius=struct(unit="km", value=6378.1363)),
  Moon=struct(
    mu=struct(value=4900.2800238, unit="km^3/s^2"),
    radius=struct(value=1738, unit="km"),
    orientation=struct(
      type="ZXZ",
      value=[0.2547045 0.3880776 0.04558641
       0.2548641 0.3880775 0.04558649
       0.2550238 0.3880773 0.04558657
       0.2551834 0.3880772 0.04558666
       0.255343 0.3880771 0.04558674
       0.2555027 0.3880769 0.04558682
       0.2556623 0.3880768 0.0455869
       0.2558219 0.3880767 0.04558698
       0.2559816 0.3880765 0.04558706
       0.2561412 0.3880764 0.04558714
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       ],
      unit="rad",
      description="ZXZ rotation angles from J2000 to MOON_PA"),
    jd_interval=struct(
      value=[2461406.5 2461407 2461407 2461407 2461407 2461407 2461407 2461407 2461407 2461406.50625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 2461421.5],
      unit="julian date",
      description="Interpolation points for Environment.Moon.eul"),
    orientation_dot=struct(
      unit="rad/s",
      description="Time derivative of the ZXZ rotation angles from J2000 to MOON_PA",
      value=[2.660601e-06 -2.243327e-09 1.360651e-09
       2.660602e-06 -2.243383e-09 1.35951e-09
       2.660603e-06 -2.24344e-09 1.35837e-09
       2.660604e-06 -2.243496e-09 1.357229e-09
       2.660605e-06 -2.243553e-09 1.356088e-09
       2.660606e-06 -2.243609e-09 1.354948e-09
       2.660607e-06 -2.243665e-09 1.353807e-09
       2.660608e-06 -2.243721e-09 1.352666e-09
       2.660609e-06 -2.243777e-09 1.351525e-09
       2.66061e-06 -2.243833e-09 1.350385e-09
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       ]),
    SH=struct(
      n=struct(value=15, description="degree index"),
      m=struct(value=15, description="order index"),
      csi=struct(
        value=[0 0 0 0 0 0 0 0 0 0 0 0 0 0 0 0
         0 0 0 0 0 0 0 0 0 0 0 0 0 0 0 0
         1.936492 2.236068 0 0 0 0 0 0 0 0 0 0 0 0 0 0
         1.972027 2.09165 2.645751 0 0 0 0 0 0 0 0 0 0 0 0 0
         1.984313 2.04939 2.291288 3 0 0 0 0 0 0 0 0 0 0 0 0
         1.989975 2.03101 2.171241 2.487469 3.316625 0 0 0 0 0 0 0 0 0 0 0
         1.993043 2.021315 2.113942 2.301368 2.673948 3.605551 0 0 0 0 0 0 0 0 0 0
         1.994891 2.015564 2.081666 2.20794 2.430862 2.850439 3.872983 0 0 0 0 0 0 0 0 0
         1.99609 2.01187 2.061553 2.153222 2.304886 2.557042 3.017804 4.123106 0 0 0 0 0 0 0 0
         1.996911 2.009353 2.048122 2.118044 2.229177 2.401636 2.679138 3.177066 4.358899 0 0 0 0 0 0 0
         1.997498 2.007561 2.038688 2.093947 2.179449 2.306513 2.496873 2.797057 3.329164 4.582576 0 0 0 0 0 0
         1.997933 2.00624 2.031798 2.076656 2.144761 2.243045 2.383769 2.590045 2.910959 3.47491 4.795832 0 0 0 0 0
         1.998263 2.005238 2.026609 2.063797 2.119478 2.198166 2.307396 2.46021 2.680951 3.02109 3.614994 5 0 0 0 0
         1.99852 2.004459 2.0226 2.05396 2.10042 2.165064 2.252818 2.371708 2.535463 2.769559 3.127716 3.75 5.196152 0 0 0
         1.998724 2.003842 2.019437 2.046257 2.085665 2.139848 2.212182 2.307928 2.435532 2.609348 2.855915 3.231099 3.880424 5.385165 0 0
         1.998889 2.003345 2.016897 2.040107 2.07399 2.120142 2.180966 2.260078 2.363017 2.498611 2.68179 2.940107 3.331481 4.006691 5.567764 0],
        description="coefficients to propagate the Legendre polynomials"),
      eta=struct(
        value=[0 0 0 0 0 0 0 0 0 0 0 0 0 0 0 0
         0 0 0 0 0 0 0 0 0 0 0 0 0 0 0 0
         1.118034 0 0 0 0 0 0 0 0 0 0 0 0 0 0 0
         1.01835 0.9354143 0 0 0 0 0 0 0 0 0 0 0 0 0 0
         1.006231 0.9797959 0.8660254 0 0 0 0 0 0 0 0 0 0 0 0 0
         1.002853 0.9910312 0.9476071 0.8291562 0 0 0 0 0 0 0 0 0 0 0 0
         1.001542 0.9952267 0.9736101 0.9251849 0.8062258 0 0 0 0 0 0 0 0 0 0 0
         1.000927 0.997155 0.9847319 0.9594032 0.9090909 0.7905694 0 0 0 0 0 0 0 0 0 0
         1.000601 0.9981668 0.9903379 0.9752174 0.9481764 0.8970695 0.7791937 0 0 0 0 0 0 0 0 0
         1.000411 0.9987492 0.9934853 0.9836628 0.9671528 0.9392246 0.8877771 0.7705518 0 0 0 0 0 0 0 0
         1.000294 0.9991083 0.9953938 0.9886231 0.9776924 0.9603921 0.931969 0.88039 0.7637626 0 0 0 0 0 0 0
         1.000217 0.9993419 0.9966205 0.9917422 0.9840839 0.9724833 0.9547016 0.9259893 0.8743815 0.7582875 0 0 0 0 0 0
         1.000165 0.9995004 0.9974457 0.993808 0.9882118 0.9799919 0.9679612 0.9498714 0.9209855 0.8694009 0.7537784 0 0 0 0 0
         1.000129 0.9996117 0.9980218 0.9952332 0.9910082 0.984941 0.9763466 0.9640269 0.9457325 0.9167415 0.8652065 0.75 0 0 0 0
         1.000102 0.9996923 0.9984363 0.9962497 0.9929753 0.9883532 0.9819623 0.9731078 0.9605869 0.9421529 0.9130991 0.8616264 0.746788 0 0 0
         1.000082 0.999752 0.9987423 0.9969948 0.9944022 0.9907909 0.9858891 0.9792674 0.9702262 0.9575614 0.9390302 0.9099404 0.8585352 0.7440238 0 0],
        description="coefficients to propagate the Legendre polynomials"),
      Cnm=struct(
        value=[0 0 0 0 0 0 0 0 0 0 0 0 0 0 0 0
         0 0 0 0 0 0 0 0 0 0 0 0 0 0 0 0
         -9.089015e-05 -2.962036e-08 3.463209e-05 0 0 0 0 0 0 0 0 0 0 0 0 0
         -3.24496e-06 2.638547e-05 1.419184e-05 1.228156e-05 0 0 0 0 0 0 0 0 0 0 0 0
         3.286678e-06 -5.978221e-06 -7.150751e-06 -1.359494e-06 -6.001626e-06 0 0 0 0 0 0 0 0 0 0 0
         -2.530739e-07 -1.144613e-06 4.419088e-06 5.473673e-07 2.74319e-06 3.046958e-06 0 0 0 0 0 0 0 0 0 0
         3.691945e-06 1.642643e-06 -4.232775e-06 -3.372817e-06 1.689058e-07 1.433699e-06 -4.560226e-06 0 0 0 0 0 0 0 0 0
         5.694974e-06 7.586529e-06 -7.75576e-07 4.16114e-07 -8.55206e-07 9.966364e-08 -9.627454e-07 -1.989445e-06 0 0 0 0 0 0 0 0
         2.288258e-06 -6.89421022522e-8 3.001645e-06 -1.878161e-06 3.633517e-06 -1.053987e-06 -2.091723e-06 -1.734175e-06 -2.320601e-06 0 0 0 0 0 0 0
         -3.468665e-06 2.113954e-06 1.855938e-06 -2.063234e-06 -1.6956e-06 -1.81353e-06 -2.599316e-06 -3.467338e-06 -9.602593e-07 -1.032916e-06 0 0 0 0 0 0
         -8.431876e-07 6.177881e-07 7.837813e-08 6.521969e-07 -3.429879e-06 3.111767e-07 5.080282e-08 -3.232749e-06 -3.83168e-06 -5.183202e-06 9.152631e-07 0 0 0 0 0
         -1.069805e-06 -1.536789e-07 8.857855e-07 6.742645e-07 -1.183309e-06 -1.973328e-07 1.029824e-06 -2.156331e-08 -3.077503e-06 -2.428352e-06 -4.252036e-06 -2.71268e-06 0 0 0 0
         -1.820747e-06 -6.061716e-07 -1.683757e-07 9.160472e-07 5.408631e-07 -1.489805e-07 1.501227e-06 1.633082e-06 -4.553863e-08 -2.848461e-07 -2.516128e-06 -1.323467e-06 -2.503102e-09 0 0 0
         1.679683e-07 8.503066e-07 -3.273164e-06 -3.063081e-07 3.979316e-07 -8.912422e-07 4.455911e-07 -7.314244e-07 1.27025897946e-7 6.765549e-07 -1.664024e-06 -2.301452e-06 -3.729462e-07 2.891582e-06 0 0
         1.2935e-07 8.700161e-07 7.909549e-07 3.02065e-07 -4.949242e-07 -1.963562e-07 -8.431507e-07 -1.263861e-06 9.175861e-07 -2.155053e-07 -1.916907e-06 -1.114342e-06 -1.446779e-07 -3.793142e-07 -1.05334790309e-6 0
         1.810526e-08 -6.620337e-07 -2.640557e-07 -1.608776e-06 -8.71284e-07 1.673588e-07 -6.427006e-07 1.148361e-06 2.202703e-06 -5.794194e-07 1.325341e-07 -1.805881e-07 -2.376406e-06 -1.869077e-06 7.740586e-07 9.989807e-07],
        description="S.h. sine coefficients"),
      Snm=struct(
        value=[0 0 0 0 0 0 0 0 0 0 0 0 0 0 0 0
         0 0 0 0 0 0 0 0 0 0 0 0 0 0 0 0
         0 -2.771463e-08 2.3783e-08 0 0 0 0 0 0 0 0 0 0 0 0 0
         0 5.511503e-06 4.945406e-06 -1.839432e-06 0 0 0 0 0 0 0 0 0 0 0 0
         0 1.73215e-06 -6.926699e-06 -1.353789e-05 4.019687e-06 0 0 0 0 0 0 0 0 0 0 0
         0 -4.213482e-06 9.333326e-07 8.930777e-06 1.745584e-07 -2.875373e-06 0 0 0 0 0 0 0 0 0 0
         0 -2.646497e-06 -2.046457e-06 -3.307713e-06 -4.346605e-06 -1.044093e-05 7.368941e-06 0 0 0 0 0 0 0 0 0
         0 -1.767727e-07 2.381876e-06 2.289896e-06 7.092975e-07 1.400394e-06 1.20922e-06 -1.750367e-06 0 0 0 0 0 0 0 0
         0 1.004944e-06 2.157063e-06 1.150316e-06 -5.25921e-07 2.88165e-06 -2.502129e-06 3.112287e-06 2.276247e-06 0 0 0 0 0 0 0
         0 2.52272e-07 -1.158783e-06 1.84099e-06 -1.793918e-06 -3.537263e-06 -2.910556e-06 3.564903e-07 -1.95079e-06 2.337577e-06 0 0 0 0 0 0
         0 -8.928975e-07 -4.652173e-07 4.070344e-07 1.931351e-06 1.867004e-07 -1.983544e-06 -1.009771e-06 2.340488e-06 -4.437666e-07 -1.602837e-06 0 0 0 0 0
         0 6.976834e-07 -1.898987e-06 7.546263e-07 2.358725e-06 2.347763e-06 -1.992404e-06 -3.057036e-06 -3.238687e-07 7.019191e-07 3.92663e-07 -1.800123e-06 0 0 0 0
         0 1.793798e-06 1.120288e-06 -4.408307e-06 -1.497768e-07 8.473515e-07 7.099519e-07 -1.561035e-07 -2.01494e-06 1.138403e-06 -1.509939e-06 -1.086454e-06 1.229639e-06 0 0 0
         0 -3.496659e-07 6.377032e-08 -8.791206e-07 2.331267e-08 7.840838e-07 1.422634e-06 -9.287708e-07 -2.284729e-06 5.658013e-07 1.958907e-07 3.477567e-07 -5.788073e-07 -2.602291e-06 0 0
         0 -7.174619e-07 6.406174e-07 4.865465e-07 -3.050147e-06 -9.290676e-07 1.912523e-06 9.629217e-07 9.603665e-07 -3.307422e-07 1.623922e-07 2.572551e-06 -1.277025e-07 -2.090856e-06 1.00788e-06 0
         0 2.562617e-07 5.614001e-07 -5.939409e-07 -1.454616e-06 -7.221579e-07 3.581956e-07 1.720285e-06 2.333352e-06 -1.835498e-06 -9.097543e-07 -6.75946488154e-7 -1.618015e-06 -2.633367e-07 1.64326e-06 7.864516e-07]),
      Pnm=struct(value=[1 0 1.732051], description="P00, P01, P11"),
      zeta=struct(
        value=[0 0 0 0 0 0 0 0 0 0 0 0 0 0 0 0
         0 0 0 0 0 0 0 0 0 0 0 0 0 0 0 0
         1.732051 2 0 0 0 0 0 0 0 0 0 0 0 0 0 0
         2.44949 3.162278 2.44949 0 0 0 0 0 0 0 0 0 0 0 0 0
         3.162278 4.242641 3.741657 2.828427 0 0 0 0 0 0 0 0 0 0 0 0
         3.872983 5.291503 4.898979 4.242641 3.162278 0 0 0 0 0 0 0 0 0 0 0
         4.582576 6.324555 6 5.477226 4.690416 3.464102 0 0 0 0 0 0 0 0 0 0
         5.291503 7.348469 7.071068 6.63325 6 5.09902 3.741657 0 0 0 0 0 0 0 0 0
         6 8.3666 8.124038 7.745967 7.211103 6.480741 5.477226 4 0 0 0 0 0 0 0 0
         6.708204 9.380832 9.165151 8.831761 8.3666 7.745967 6.928203 5.830952 4.242641 0 0 0 0 0 0 0
         7.416198 10.3923 10.19804 9.899495 9.486833 8.944272 8.246211 7.348469 6.164414 4.472136 0 0 0 0 0 0
         8.124038 11.40175 11.22497 10.95445 10.58301 10.0995 9.486833 8.717798 7.745967 6.480741 4.690416 0 0 0 0 0
         8.831761 12.40967 12.24745 12 11.6619 11.22497 10.67708 10 9.165151 8.124038 6.78233 4.898979 0 0 0 0
         9.539392 13.41641 13.2665 13.0384 12.72792 12.32883 11.83216 11.22497 10.48809 9.591663 8.485281 7.071068 5.09902 0 0 0
         10.24695 14.42221 14.28286 14.07125 13.78405 13.41641 12.96148 12.40967 11.74734 10.95445 10 8.831761 7.348469 5.291503 0 0
         10.95445 15.42725 15.29706 15.09967 14.8324 14.49138 14.07125 13.56466 12.96148 12.24745 11.40175 10.3923 9.165151 7.615773 5.477226 0],
        description="coefficients to compute the gravitational acceleration"),
      Znm=struct(
        value=[0 0 0 0 0 0 0 0 0 0 0 0 0 0 0 0
         0 0 0 0 0 0 0 0 0 0 0 0 0 0 0 0
         3.464102 0 0 0 0 0 0 0 0 0 0 0 0 0 0 0
         7.745967 7.745967 0 0 0 0 0 0 0 0 0 0 0 0 0 0
         13.41641 15.87451 10.58301 0 0 0 0 0 0 0 0 0 0 0 0 0
         20.4939 25.92296 20.78461 13.41641 0 0 0 0 0 0 0 0 0 0 0 0
         28.98275 37.94733 32.86335 25.69047 16.24808 0 0 0 0 0 0 0 0 0 0 0
         38.88444 51.96152 46.90416 39.7995 30.59412 19.07878 0 0 0 0 0 0 0 0 0 0
         50.1996 67.97058 62.92853 55.85696 46.73329 35.49648 21.9089 0 0 0 0 0 0 0 0 0
         62.92853 85.97674 80.94443 73.89181 64.80741 53.66563 40.39802 24.73863 0 0 0 0 0 0 0 0
         77.0714 105.9811 100.9554 93.91486 84.85281 73.75636 60.59703 45.29901 27.5681 0 0 0 0 0 0 0
         92.62829 127.9844 122.9634 115.931 106.8831 95.81232 82.70429 67.52777 50.1996 30.39737 0 0 0 0 0 0
         109.5993 151.9868 146.9694 139.9428 130.9045 119.8499 106.7708 91.65151 74.45804 55.09991 33.2265 0 0 0 0 0
         127.9844 177.9888 172.974 165.9518 156.9204 145.8767 132.8157 117.7285 100.5982 81.38796 60 36.05551 0 0 0 0
         147.7836 205.9903 200.9776 193.9588 184.9324 173.8965 160.8478 145.7807 128.6857 109.5445 88.31761 64.89992 38.88444 0 0 0
         168.997 235.9915 230.9805 223.9643 214.9419 203.9117 190.8717 175.8181 158.7451 139.6424 118.4905 95.24705 69.79971 41.71331 0 0]))),
  Mars=struct(mu=struct(value=42828, unit="km^3/s^2")),
  Jupiter=struct(mu=struct(value=126686534, unit="km^3/s^2")),
  Saturn=struct(mu=struct(value=37931187, unit="km^3/s^2")),
  Neptune=struct(mu=struct(value=6836529, unit="km^3/s^2")),
  Pluto=struct(mu=struct(value=871, unit="km^3/s^2")),
  Uranus=struct(mu=struct(value=5793939, unit="km^3/s^2")),
  Date=struct(year=2027, month=1, day=1, hour=0, min=0, sec=0),
  AU=struct(unit="km", description="Astronomical Unit to km conversion", value=149597870.691),
  c=struct(unit="m/s", description="Speed of light in vacuum", value=299792458))

TestData = struct(
  SH=struct(
    n=struct(value=5),
    m=struct(value=5),
    csi=struct(
      value=[0 0 0 0 0 0
       0 0 0 0 0 0
       1.936492 2.236068 0 0 0 0
       1.972027 2.09165 2.645751 0 0 0
       1.984313 2.04939 2.291288 3 0 0
       1.989975 2.03101 2.171241 2.487469 3.316625 0]),
    eta=struct(
      value=[0 0 0 0 0 0
       0 0 0 0 0 0
       1.118034 0 0 0 0 0
       1.01835 0.9354143 0 0 0 0
       1.006231 0.9797959 0.8660254 0 0 0
       1.002853 0.9910312 0.9476071 0.8291562 0 0]),
    zeta=struct(
      value=[0 0 0 0 0 0
       0 0 0 0 0 0
       1.732051 2 0 0 0 0
       2.44949 3.162278 2.44949 0 0 0
       3.162278 4.242641 3.741657 2.828427 0 0
       3.872983 5.291503 4.898979 4.242641 3.162278 0]),
    Znm=struct(
      value=[0 0 0 0 0 0
       0 0 0 0 0 0
       3.464102 0 0 0 0 0
       7.745967 7.745967 0 0 0 0
       13.41641 15.87451 10.58301 0 0 0
       20.4939 25.92296 20.78461 13.41641 0 0]),
    Pnm=struct(value=[1 0 1.732051]),
    mu=struct(value=398600470000000),
    ref_radius=struct(value=6378139),
    Cnm=struct(
      value=[1 0 0 0 0 0 0 0 0 0 0 0 0 0 0 0
       0 0 0 0 0 0 0 0 0 0 0 0 0 0 0 0
       -0.00048416544 1.04e-9 2.43404e-6 0 0 0 0 0 0 0 0 0 0 0 0 0
       9.5838e-7 2.02855e-6 8.9272e-7 7.0028e-7 0 0 0 0 0 0 0 0 0 0 0 0
       5.4112e-7 -5.3521e-7 3.5208e-7 9.885e-7 -1.9531e-7 0 0 0 0 0 0 0 0 0 0 0
       6.862e-8 -5.117e-8 6.5146e-7 -4.6712e-7 -2.8754e-7 1.5617e-7 0 0 0 0 0 0 0 0 0 0
       0 0 0 0 0 0 0 0 0 0 0 0 0 0 0 0
       0 0 0 0 0 0 0 0 0 0 0 0 0 0 0 0
       0 0 0 0 0 0 0 0 0 0 0 0 0 0 0 0
       0 0 0 0 0 0 0 0 0 0 0 0 0 0 0 0
       0 0 0 0 0 0 0 0 0 0 0 0 0 0 0 0
       0 0 0 0 0 0 0 0 0 0 0 0 0 0 0 0
       0 0 0 0 0 0 0 0 0 0 0 0 0 0 0 0
       0 0 0 0 0 0 0 0 0 0 0 0 0 0 0 0
       0 0 0 0 0 0 0 0 0 0 0 0 0 0 0 0
       0 0 0 0 0 0 0 0 0 0 0 0 0 0 0 0]),
    Snm=struct(
      value=[0 0 0 0 0 0 0 0 0 0 0 0 0 0 0 0
       0 0 0 0 0 0 0 0 0 0 0 0 0 0 0 0
       0 -2.43e-9 -1.39907e-6 0 0 0 0 0 0 0 0 0 0 0 0 0
       0 2.5197e-7 -6.2346e-7 1.4125e-6 0 0 0 0 0 0 0 0 0 0 0 0
       0 -4.6926e-7 6.6404e-7 -2.0179e-7 2.9883e-7 0 0 0 0 0 0 0 0 0 0 0
       0 -9.379e-8 -3.2769e-7 -2.0298e-7 4.99e-8 -6.5983e-7 0 0 0 0 0 0 0 0 0 0
       0 0 0 0 0 0 0 0 0 0 0 0 0 0 0 0
       0 0 0 0 0 0 0 0 0 0 0 0 0 0 0 0
       0 0 0 0 0 0 0 0 0 0 0 0 0 0 0 0
       0 0 0 0 0 0 0 0 0 0 0 0 0 0 0 0
       0 0 0 0 0 0 0 0 0 0 0 0 0 0 0 0
       0 0 0 0 0 0 0 0 0 0 0 0 0 0 0 0
       0 0 0 0 0 0 0 0 0 0 0 0 0 0 0 0
       0 0 0 0 0 0 0 0 0 0 0 0 0 0 0 0
       0 0 0 0 0 0 0 0 0 0 0 0 0 0 0 0
       0 0 0 0 0 0 0 0 0 0 0 0 0 0 0 0])))

OrbitCtrl = struct(
  bangbang=struct(
    on=struct(value=0.1, unit="deg", description="Error necessary to trigger orbit control"),
    off=struct(
      value=-0.05,
      unit="deg",
      description="Error necessary to stop orbit control once it has been activated")),
  target_i=struct(value=45, unit="deg", description="target orbital inclination (MCI frame)"),
  target_uMax=struct(value=3.173009, unit="rad", description="Max argument of longitude to perform the maneuver"),
  target_uMin=struct(description="Min argument of longitude to perform the maneuver", value=3.110177, unit="rad"),
  a_thrust=struct(value=0.08, unit="m/s^2", description="acceleration generated by the thruster (assumed constant)"))

MainSpacecraft = struct(
  mass=struct(value=25, unit="kg", description="Spacecraft mass"),
  radius=struct(
    value=0.1595769,
    unit="m",
    description="Equivalent radius of a sphere with the same surface area of a 12u (20x20x30 cm) cubesat"),
  rp_coeff=struct(unit="", description="Radiation pressure coefficient", nominal=1.3, std=0.03),
  x0=struct(
    unit="km",
    description="Initial position of the spacecraft in MCI",
    nominal=[1.224647e-13; 2000; 0],
    std=[0.1; 0.1; 0.1]),
  v0=struct(
    unit="km/s",
    description="Initial velocity of the spacecraft in MCI",
    nominal=[-1.106829; 6.777372e-17; 1.106829],
    std=[0.0001; 0.0001; 0.0001]),
  q0=struct(
    value=[-0.2705981; 0.6532815; -0.6532815; -0.2705981],
    unit="",
    description="Initial attitude of the spacecraft w.r.t MCI"))

BeaconSpacecraft = struct(
  mass=struct(value=25, unit="kg", description="Spacecraft mass"),
  radius=struct(
    value=0.1595769,
    unit="m",
    description="Equivalent radius of a sphere with the same surface area of a 12u (20x20x30 cm) cubesat"),
  rp_coeff=struct(unit="", description="Radiation pressure coefficient", nominal=1.3, std=0.03),
  x0=struct(
    unit="km",
    description="Initial position of the spacecraft in MCI",
    nominal=[-39287.5; -6.383566; 23560.21],
    std=[0.1; 0.1; 0.1]),
  v0=struct(
    unit="km/s",
    description="Initial velocity of the spacecraft in MCI",
    nominal=[0.08814962; -0.3665789; -0.02217941],
    std=[0.0001; 0.0001; 0.0001]),
  q0=struct(
    value=[0.6369527; -0.5928241; 0.3606787; -0.3358],
    unit="",
    description="Initial attitude of the spacecraft w.r.t MCI"))