% Simulink data dictionary Sensors.sldd

starTracker = struct(
  nPixel=struct(value=1024, description="number of pixels per side of the sensor", unit=""),
  pixelSize=struct(value=0.005, description="length of one pixel", unit="mm"),
  f=struct(value=29, description="focal length", unit="mm"),
  fov=struct(value=0.1760953, description="field of view", unit="rad"),
  exclusionAngle=struct(
    value=0.6108652,
    description="minimum allowed separation between boresight and sun direction",
    unit="rad"),
  A_BS=struct(
    value=[1 0 0; 0 -1 0; 0 0 -1],
    description="Rotation matrix to transform a vector from sensor to body frame (180 deg rotation around x)",
    unit=""),
  catalogue=struct(
    description="list of unit vectors describing the position of the stars in inertial frame",
    unit="",
    value=[-0.436218 0.1677623 0.8840643 0.03
     0.3471447 0.254538 0.9026079 0.08
     0.3392241 0.03224954 -0.9401526 0.12
     -0.07681528 0.4844016 -0.8714669 0.38
     0.5888224 -0.5000399 -0.6350183 0.46
     0.2923131 0.3185394 0.9017127 0.5
     0.6919831 0.3507139 0.6309985 0.61
     0.6180982 -0.5822032 0.5281988 0.77
     -0.6894844 0.09367696 -0.7182172 0.85
     -0.1802583 0.1987381 -0.9633328 0.96
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     ]),
  maxStars=struct(value=10, unit="", description="Maximum number of stars used for the attitude determination"),
  noise=struct(value=0.1, unit="", description="3sigma error of the centroid coordinates, in pixel lengths"),
  tol=struct(
    unit="rad",
    value=1.0e-8,
    description="maximum angular error allowed for the power method in the quest algorithm"),
  sampleTime=struct(value=1, unit="s", description="Sensor's sample time"))

IMU = struct(
  accelerometer=struct(
    scaleFactor=struct(nominal=0, std=6.666667e-05, unit="", description="Dimensionless scale factor uncertainty"),
    misalignment=struct(nominal=0, std=0.00033, unit="rad", description="misalignment angles uncertainty"),
    nonOrthogonality=struct(nominal=0, std=6.666667e-05, unit="rad", description="Non orthogonalities angles uncertainty"),
    nonLinearitySlope=struct(
      value=2.038736e-06,
      unit="",
      description="Slope of the non linearity scale factor error.The non linearity error is assumed completely deterministic and linear with the measurement"),
    sampleTime=struct(value=0.03333333, unit="s", description="Sensor's sampling time"),
    Tb=struct(value=81.2176, unit="s", description="Bias instability correlation time"),
    Sb=struct(value=9.676761e-09, unit="m^2/s^5", description="Fliker noise's PSD"),
    N=struct(value=0.001166667, unit="m/s^(3/2)", description="Velocity Random Walk's PSD's square root"),
    range=struct(value=98.1, unit="m/s^2", description="Full scale range"),
    resolution=struct(value=1.8639e-5, unit="m/s^2", description="Sensor's resolution"),
    bias=struct(nominal=0, std=0.0024525, unit="m/s^2", description="Constant bias uncertainty"),
    K=struct(
      value=1.318524e-05,
      unit="m/s^(5/2)",
      description="square root of the PSD of the white noise driving the brownian noise")),
  gyroscope=struct(
    scaleFactor=struct(nominal=0, std=0.0001666667, unit="", description="Dimensionless scale factor uncertainty"),
    misalignment=struct(nominal=0, std=0.00033, unit="rad", description="misalignment angles uncertainty"),
    nonOrthogonality=struct(nominal=0, std=6.666667e-05, unit="rad", description="Non orthogonalities angles uncertainty"),
    nonLinearitySlope=struct(
      value=7.5e-8,
      unit="",
      description="Slope of the non linearity scale factor error.The non linearity error is assumed completely deterministic and linear with the measurement"),
    sampleTime=struct(value=0.03333333, unit="s", description="Sensor's sampling time"),
    Tb=struct(value=590.8245, unit="s", description="Bias instability correlation time"),
    Sb=struct(value=7.089145e-11, unit="deg^2/s^3", description="Fliker noise's PSD"),
    N=struct(value=0.0025, unit="deg/s^(3/2)", description="Velocity Random Walk's PSD's square root"),
    range=struct(value=400, unit="deg/s", description="Full scale range"),
    resolution=struct(value=6.111111e-05, unit="deg/s", description="Sensor's resolution"),
    bias=struct(nominal=0, std=0.0003703704, unit="m/s^2", description="Constant bias uncertainty"),
    biasG=struct(value=0.0002777778, unit="deg/s/g", description="Linear acceleration effect on bias"),
    scaleFactorG=struct(value=5e-05, unit="1/g", description="Linear acceleration effect on scale factor"),
    K=struct(
      value=1.703518e-06,
      unit="deg/s^(3/2)",
      description="square root of the PSD of the white noise driving the brownian noise")),
  position=struct(value=[0.15; 0.05; 0.05], unit="m", description="IMU position wrt baricenter"),
  orientation=struct(
    value=[0.5235988; 0.7853982; 1.047198],
    unit="rad",
    description="ZXZ rotation angles from body to sensor frame"))

Radio = struct(
  f=struct(value=1575420000, unit="Hz", description="Frequency of the radio signal"),
  lambda=struct(value=0.1902937, unit="m", description="Wavelength of the radio signals"),
  N0=struct(value=-200.9, unit="dBW", description="Typical thermal noise, in dBW"),
  Rx=struct(
    A=struct(value=0.0025, unit="m^2", description="Effective area of the antenna"),
    gain=struct(value=-0.6169882, unit="dB", description="Gain of the antenna"),
    losses=struct(value=2, unit="dB", description="Receiver implementation loss, typical value")),
  Tx=struct(
    A=struct(value=0.04, unit="m^2", description="Effective area of the antenna"),
    gain=struct(unit="dB", description="Gain of the antenna", value=11.42421),
    P=struct(value=10, unit="dBW", description="Transmitting power, equivalent to 10W")),
  PN=struct(
    Bn=struct(value=0.2, unit="Hz", description="code loop noise bandwidth"),
    D=struct(value=1, unit="chip", description="Early-to-late correlator spacing"),
    T=struct(value=0.02, unit="s", description="Predetection integration time"),
    Tc=struct(value=1.0e-6, unit="s", description="chip period"),
    Bfe=struct(value=2000000, unit="Hz", description="double-sided front end bandwidth"),
    lambda_c=struct(value=293.1, unit="m/chip", description="chip wavelength")),
  sampleTime=struct(value=0.1, unit="s", description="Pulse generator sample time"),
  delay=struct(value=1, unit="samples", description="Pulse generator phase delay"),
  pulseSamples=struct(value=100, unit="samples", description="Pulse generator period"),
  pulseWidth=struct(value=1, unit="samples", description="Pulse generator pulse width"),
  Phase=struct(
    Bn=struct(value=20, unit="Hz", description="Carrier loop noise bandwidth"),
    T=struct(value=0.02, unit="s", description="Predetection integration time")))

clock = struct(
  deltaT0=struct(unit="s", description="Clock bias: constant over time but with uncertain value", nominal=0, std=0.0001),
  deltaT1=struct(unit="s/s", description="Stochastic clock drift", nominal=0, std=7.0e-8),
  deltaT2=struct(std=1.0e-16, unit="s/s^2", description="Stochastic clock aging", nominal=0),
  Tb=struct(value=52.91005, unit="s", description="flicker noise correlation time"),
  N=struct(value=3.162278e-13, unit="s/s^(1/2)", description="Square root of the white noise PSD"),
  K=struct(
    value=5.477226e-15,
    description="square root of the PSD of the white noise driving the brownian noise",
    unit="s/s^(3/2)"),
  Sb=struct(description="Fliker noise's PSD", unit="s^2/s^3", value=9.928022e-28),
  sampleTime=struct(value=0.03333333, unit="s", description="Sensor's sampling time"),
  T1=struct(nominal=0))